# Grasshopper definition shelving.gh (Grasshopper 0.9.76)
# plug-ins: Anemone

dimensions = Slider(197, range=0..1000)
material_thickness = Slider(4.4, range=0..10)
Y = UnitY(Factor=1)
X = UnitX(Factor=1)
pt = Point(<point referenced from the Rhino model>)
rectangle = Rectangle(Plane=pt, XSize=dimensions, YSize=dimensions, Radius=0)  # -> Rectangle, Length
rad = Radians(Degrees="0")
area = Area(Geometry=rectangle.Rectangle)  # -> Area, Centroid
rot3d = Rotate3D(Geometry=rectangle.Rectangle, Angle=rad, Center=area.Centroid, Axis=X)  # -> Geometry, Transform
explode = Explode(Curve=rot3d.Geometry, Recursive=True)  # -> graft(Segments), graft(Vertices)
bang = ExplodeTree(Data=explode.Vertices)  # -> Branch0, Branch1, Branch2
division = Division(A=dimensions, B="4")
pline = PolyLine(Vertices=flatten([bang.Branch0, bang.Branch1, bang.Branch2]), Closed=True)
boundary = BoundarySurfaces(Edges=pline)
number_slider = Slider(0.5, range=0..1)
explode_2 = Explode(Curve=pline, Recursive=True)  # -> graft(Segments), graft(Vertices)
bang_2 = ExplodeTree(Data=explode_2.Segments)  # -> Branch0, Branch1, Branch2
division_2 = Division(A=material_thickness, B="2")
rad_2 = Radians(Degrees="90")
eval = EvaluateCurve(Curve=reparameterize(bang_2.Branch1), Parameter=number_slider)  # -> Point, Tangent, Angle
amp = Amplitude(Vector=bang_2.Branch0, Amplitude=division_2)
eval_2 = EvaluateCurve(Curve=reparameterize(bang_2.Branch2), Parameter=number_slider)  # -> Point, Tangent, Angle
eval_3 = EvaluateCurve(Curve=reparameterize(bang_2.Branch0), Parameter=number_slider)  # -> Point, Tangent, Angle
multiplication = Multiplication(A=amp, B="-1")
amp_2 = Amplitude(Vector=bang_2.Branch1, Amplitude=division_2)
amp_3 = Amplitude(Vector=bang_2.Branch1, Amplitude=division_2)
rotate = Rotate(Geometry=bang_2.Branch1, Angle=rad_2, Plane=boundary)  # -> Geometry, Transform
move = Move(Geometry=eval_3.Point, Motion=amp)  # -> Geometry, Transform
rotate_2 = Rotate(Geometry=bang_2.Branch0, Angle=rad_2, Plane=boundary)  # -> Geometry, Transform
move_2 = Move(Geometry=eval_3.Point, Motion=multiplication)  # -> Geometry, Transform
amp_4 = Amplitude(Vector=rotate.Geometry, Amplitude=division)
amp_5 = Amplitude(Vector=rotate_2.Geometry, Amplitude=division)
move_3 = Move(Geometry=eval.Point, Motion=amp_3)  # -> Geometry, Transform
multiplication_2 = Multiplication(A=amp_2, B="-1")
move_4 = Move(Geometry=eval.Point, Motion=amp_4)  # -> Geometry, Transform
move_5 = Move(Geometry=eval_3.Point, Motion=amp_5)  # -> Geometry, Transform
rec_3pt = Rectangle3Pt(PointA=move_2.Geometry, PointB=move.Geometry, PointC=move_5.Geometry)  # -> Rectangle, Length
pt_2 = Point(eval.Point)
move_6 = Move(Geometry=eval.Point, Motion=multiplication_2)  # -> Geometry, Transform
ln = Line(StartPoint=eval.Point, EndPoint=move_4.Geometry)
ln_2 = Line(StartPoint=eval_3.Point, EndPoint=move_5.Geometry)
boundary_2 = BoundarySurfaces(Edges=rec_3pt.Rectangle)
end = EndPoints(Curve=ln_2)  # -> Start, End
rec_3pt_2 = Rectangle3Pt(PointA=move_6.Geometry, PointB=move_3.Geometry, PointC=move_4.Geometry)  # -> Rectangle, Length
boundary_3 = BoundarySurfaces(Edges=rec_3pt_2.Rectangle)
rdiff = RegionDifference(CurvesA=boundary, CurvesB=flatten([boundary_2, boundary_3]))
md_slider = MDSlider(slider_value=Point(0.5, 0.5, 0.5), SliderMode=0, x_domain=Domain(0, 1), y_domain=Domain(0, 1), z_domain=Domain(0, 1))
crv = Curve(bang_2.Branch1)
boundary_4 = BoundarySurfaces(Edges=rdiff)
evalsrf = EvaluateSurface(Surface=boundary_4, Point=md_slider)  # -> Point, Normal, Frame
amp_6 = Amplitude(Vector=evalsrf.Normal, Amplitude=division_2)
move_7 = Move(Geometry=ln, Motion=amp_6)  # -> Geometry, Transform
end_2 = EndPoints(Curve=move_7.Geometry)  # -> Start, End
eval_4 = EvaluateCurve(Curve=reparameterize(move_7.Geometry), Parameter=number_slider)  # -> Point, Tangent, Angle
amp_7 = Amplitude(Vector=evalsrf.Normal, Amplitude=division_2)
amp_8 = Amplitude(Vector=evalsrf.Normal, Amplitude=material_thickness)
rad_3 = Radians(Degrees="90")
move_8 = Move(Geometry=crv, Motion=amp_7)  # -> Geometry, Transform
addition = Addition(A="90", B="90")
end_3 = EndPoints(Curve=move_8.Geometry)  # -> Start, End
extr = Extrude(Base=boundary_4, Direction=amp_8)
rot3d_2 = Rotate3D(Geometry=extr, Angle=rad_3, Center=eval_4.Point, Axis=move_7.Geometry)  # -> Geometry, Transform
rad_4 = Radians(Degrees=addition)
Z = UnitZ(Factor=1)
rad_5 = Radians(Degrees="90")
rad_6 = Radians(Degrees=addition)
rot3d_3 = Rotate3D(Geometry=extr, Angle=rad_5, Center=end_3.End, Axis=move_8.Geometry)  # -> Geometry, Transform
geo = Geometry(extr)
rot3d_4 = Rotate3D(Geometry=rot3d_2.Geometry, Angle=rad_4, Center=end_2.End, Axis=Z)  # -> Geometry, Transform
rotate_3 = Rotate(Geometry=rot3d_3.Geometry, Angle=rad_6, Plane=pt_2)  # -> Geometry, Transform
debrep = DeconstructBrep(Brep=geo)  # -> Faces, Edges, Vertices
toggle = BooleanToggle(False)
preview = CustomPreview(Geometry=rotate_3.Geometry, Shader=ColourSwatch(SwatchColor=RGBA(194, 167, 167, 33)))
wires = BrepWireframe(Brep=[geo, rot3d_4.Geometry, rotate_3.Geometry], Density=-3)
preview_2 = CustomPreview(Geometry=geo, Shader=ColourSwatch(SwatchColor=RGB(255, 255, 255)))
preview_3 = CustomPreview(Geometry=rot3d_4.Geometry, Shader=ColourSwatch(SwatchColor=RGBA(0, 0, 0, 81)))
item = ListItem(List=debrep.Vertices, Index="43", Wrap=True)
edges = BrepEdges(Brep=rotate_3.Geometry)  # -> Naked, Interior, NonManifold
debrep_2 = DeconstructBrep(Brep=rotate_3.Geometry)  # -> Faces, Edges, Vertices
pt_3 = Point(end.End)
loop_start = LoopStart(Repeat="3", Trigger=Button())  # -> port, Counter, Data
merge = Merge(Data1=rot3d_4.Geometry, Data2=rotate_3.Geometry, Data3=geo)
item_2 = ListItem(List=debrep_2.Vertices, Index="43", Wrap=True)
vec2pt = Vector2Pt(PointA=item, PointB=item_2, Unitize=False)  # -> Vector, Length
move_9 = Move(Geometry=[geo, rotate_3.Geometry, rot3d_4.Geometry], Motion=vec2pt.Vector)  # -> Geometry, Transform
