# Grasshopper definition skin.gh (Grasshopper 0.9.76)
# plug-ins: MeshEdit Components, Kangaroo Components, LunchBox, Weaverbird, MeshDual, Starling

mesh = Mesh(<mesh referenced from the Rhino model>)
number_slider = Slider(2, range=0..10)
edges = BrepEdges(Brep=mesh)  # -> Naked, Interior, NonManifold
wbnaked = WeaverbirdsNakedBoundary(MeshClosedPolylines=mesh)
wbloop = WeaverbirdsLoopSubdivision(MeshCurves=mesh, Level=number_slider, SmoothNakedEdges=1)
wbcatmullclark = WeaverbirdsCatmullClarkSubdivision(MeshCurves=mesh, Level=number_slider, SmoothNakedEdges=1)
meshdual = MeshDual(Mesh=wbloop, Center=Slider(3, range=0..10))
planar = Planar(Curve=meshdual)  # -> Planar, Plane, Deviation
dispatch = Dispatch(List=meshdual, DispatchPattern=planar.Planar)  # -> ListA, ListB
boundary = BoundarySurfaces(Edges=dispatch.ListA)
crv = Curve(meshdual)
len = Length(Curve=crv)  # -> simplify(Length)
sort = SortList(Keys=len, ValuesA=crv)  # -> Keys, ValuesA
larger = LargerThan(FirstNumber=len, SecondNumber=Slider(89.3, range=0..214))  # -> LargerThan, OrEqualTo
panel = Panel(len)
dispatch_2 = Dispatch(List=crv, DispatchPattern=larger.LargerThan)  # -> ListA, ListB
number_slider_2 = Slider(0.5, range=0..1)
number_slider_3 = Slider(0.8, range=0..1)
cp = ControlPoints(Curve=dispatch_2.ListB)  # -> Points, Weights, Knots
larger_2 = LargerThan(FirstNumber=dispatch_2.ListA, SecondNumber=Slider(57, range=0..200))  # -> LargerThan, OrEqualTo
hull = ConvexHull(Points=cp.Points, Plane=PlaneXY(0, 0, 0))  # -> simplify(Hull), simplify(HullZ), Indices
explode = Explode(Curve=hull.HullZ, Recursive=True)  # -> Segments, Vertices
eval = EvaluateCurve(Curve=reparameterize(explode.Segments), Parameter=number_slider_2)  # -> Point, Tangent, Angle
dispatch_3 = Dispatch(List=dispatch_2.ListA, DispatchPattern=larger_2.LargerThan)  # -> ListA, ListB
crv_2 = Curve(hull.HullZ)
cp_2 = ControlPoints(Curve=dispatch_3.ListA)  # -> Points, Weights, Knots
slstarmesh = SlStarMesh(Polyline=crv_2)
wbedges = WeaverbirdsMeshEdges(MeshOrPolylines=slstarmesh)
scale = Scale(Geometry=explode.Segments, Center=eval.Point, Factor=Slider(0.8, range=0..1))  # -> Geometry, Transform
hull_2 = ConvexHull(Points=cp_2.Points, Plane=PlaneXY(0, 0, 0))  # -> simplify(Hull), simplify(HullZ), Indices
cp_3 = ControlPoints(Curve=dispatch_3.ListB)  # -> simplify(Points), Weights, Knots
slstarmesh_2 = SlStarMesh(Polyline=hull_2.HullZ)
pline = PolyLine(Vertices=cp_3.Points, Closed=True)
hull_3 = ConvexHull(Points=cp_3.Points, Plane=PlaneXY(0, 0, 0))  # -> simplify(Hull), simplify(HullZ), Indices
explode_2 = MeshExplode(Mesh=slstarmesh, Interpolate=False)
explode_3 = Explode(Curve=hull_2.HullZ, Recursive=True)  # -> Segments, Vertices

# ---- group: triangulate
preview = CustomPreview(Geometry=slstarmesh, Shader=ColourSwatch(SwatchColor=RGB(176, 172, 189)))

# ----
slstarmesh_3 = SlStarMesh(Polyline=hull_3.HullZ)
eval_2 = EvaluateCurve(Curve=reparameterize(explode_3.Segments), Parameter=number_slider_3)  # -> Point, Tangent, Angle
wbnaked_2 = WeaverbirdsNakedBoundary(MeshClosedPolylines=explode_2)
area = Area(Geometry=slstarmesh_3)  # -> Area, graft(Centroid)
explode_4 = Explode(Curve=hull_3.HullZ, Recursive=True)  # -> Segments, Vertices
boundary_2 = BoundarySurfaces(Edges=wbnaked_2)
number_slider_4 = Slider(0.8, range=0..1)
merge = Merge(Data1=area.Centroid, Data2=explode_4.Vertices)
scale_2 = Scale(Geometry=explode_3.Segments, Center=eval_2.Point, Factor=number_slider_2)  # -> Geometry, Transform
duppt = RemoveDuplicatePts(Points=merge, Tolerance=0.01)
preview_2 = CustomPreview(Geometry=slstarmesh_2, Shader=ColourSwatch(SwatchColor=RGB(12, 39, 71)))
wbnaked_3 = WeaverbirdsNakedBoundary(MeshClosedPolylines=slstarmesh_2)
item = ListItem(List=duppt, Index=0, Wrap=True)  # -> Item, Item1, Item2, Item3, Item4, Item5, Item6
pline_2 = PolyLine(Vertices=[item.Item, item.Item1, item.Item2, item.Item3], Closed=True)
pline_3 = PolyLine(Vertices=[item.Item, item.Item5, item.Item4, item.Item3], Closed=True)
pline_4 = PolyLine(Vertices=[item.Item1, item.Item6, item.Item5, item.Item], Closed=True)
slsourcemesh = SlSourceMesh(Polyline=pline_2)
slsourcemesh_2 = SlSourceMesh(Polyline=pline_3)
slsourcemesh_3 = SlSourceMesh(Polyline=pline_4)
merge_2 = Merge(Data1=slsourcemesh, Data2=slsourcemesh_2, Data3=slsourcemesh_3)
merge_3 = Merge(Data1=pline_2, Data2=pline_3, Data3=pline_4)
cp_4 = ControlPoints(Curve=merge_3)  # -> Points, Weights, Knots
preview_3 = CustomPreview(Geometry=slsourcemesh, Shader=ColourSwatch(SwatchColor=RGB(74, 105, 240)))
preview_4 = CustomPreview(Geometry=slsourcemesh_2, Shader=ColourSwatch(SwatchColor=RGB(121, 142, 237)))
preview_5 = CustomPreview(Geometry=slsourcemesh_3, Shader=ColourSwatch(SwatchColor=RGB(186, 199, 255)))
hull_4 = ConvexHull(Points=cp_4.Points, Plane=PlaneXY(0, 0, 0))  # -> Hull, HullZ, Indices
wbnaked_4 = WeaverbirdsNakedBoundary(MeshClosedPolylines=slsourcemesh)
wbnaked_5 = WeaverbirdsNakedBoundary(MeshClosedPolylines=slsourcemesh_2)
wbnaked_6 = WeaverbirdsNakedBoundary(MeshClosedPolylines=slsourcemesh_3)
patch = PatchSurface(EdgeCurves=wbnaked_6, U=2, V=2, Tolerance=0.001)
# step 5
# deal with the produced geometry
explode_5 = Explode(Curve=[wbnaked_4, wbnaked_5, wbnaked_6], Recursive=True)  # -> Segments, Vertices
boundary_3 = BoundarySurfaces(Edges=wbnaked_4)
eval_3 = EvaluateCurve(Curve=reparameterize(explode_5.Segments), Parameter=Slider(0.5, range=0..1))  # -> Point, Tangent, Angle
scale_3 = Scale(Geometry=explode_5.Segments, Center=eval_3.Point, Factor=number_slider_3)  # -> Geometry, Transform
